# Grasshopper definition ExportFile.ghx (Grasshopper 0.9.76)
# plug-ins: GH_CPython

panel = Panel("""Hello World
Hello Python""")
list = ValueList({"txt": 1, "gcode": 2}, selected="gcode")
gh_cpython = GH_CPython(File_Name="181019", File_Type=list, MSG=panel, TF=Toggle(True))  # -> a, debug; inputs File_Name: list, File_Type: list, MSG: list, TF: list
# ---------- gh_cpython: Python ----------
def TYPE(num):
    if num == 1:
        type = ".txt"
    elif num == 2:
        type = ".gcode"
    return type


debug = []

file_name = str(File_Name)
file_type = TYPE(File_Type)
msg = MSG


#debug.append(MSG[1])


for i in xrange(len(msg)):
    debug.append(msg[i])
    if i < len(msg)-1:
        debug.append("\n")



path_out = 'C:\Users\yoshioca\Desktop\\' + file_name + file_type

a = path_out


if TF:
    f = open(path_out, "w")
    f.writelines(debug)
    f.close
# ---------- end gh_cpython ----------
panel_2 = Panel(gh_cpython.a)
panel_3 = Panel(gh_cpython.debug)
