# Grasshopper definition Write-gcode-ver2.ghx (Grasshopper 0.9.76)
# plug-ins: Python Interpreter, GH_CPython

# ---- group: W
number_slider = Slider(4, range=0..100)

number_slider_2 = Slider(20, range=0..100)

# ----
number_slider_3 = Slider(150, range=0..1000)

# ---- group: Margin
number_slider_4 = Slider(25, range=1..200)

# ---- group: size
panel = Panel("500")

# ---- group: Margin
number_slider_5 = Slider(25, range=1..200)

# ---- group: size
panel_2 = Panel("500")

# ---- group: layer_count
number_slider_6 = Slider(175, range=1..350)

# ---- group: layer_height
number_slider_7 = Slider(1.5, range=0.1..30)

# ----
rectangle = Rectangle(Plane=PlaneXY(0, 0, 0), XSize="0 to 800", YSize="0 to 800", Radius=0)  # -> Rectangle, Length
crv = Curve(rectangle.Rectangle)

rectangle_2 = Rectangle(Plane=PlaneXY(0, 0, 0), XSize="200 to 600", YSize="200 to 600", Radius=0)  # -> Rectangle, Length
crv_2 = Curve(rectangle_2.Rectangle)

# ---- group: layer_height
number_slider_8 = Slider(1.5, range=0.1..30)

# ----
neg = Negative(Value=number_slider_4)
multiplication = Multiplication(A=number_slider_6, B=number_slider_8)
division = Division(A="65", B=number_slider)
addition = Addition(A=panel, B=number_slider_4)
neg_2 = Negative(Value=number_slider_5)
division_2 = Division(A=panel_2, B=number_slider_2)
addition_2 = Addition(A=panel_2, B=number_slider_5)
Y = UnitY(Factor=neg)
pt = ConstructPoint(XCoordinate=Slider(40, range=0..1000), YCoordinate=Slider(150, range=0..1000), ZCoordinate=0)
multiplication_2 = Multiplication(A=multiplication, B="2")
Y_2 = UnitY(Factor=neg_2)
addition_3 = Addition(A=addition, B=number_slider_4)
pt_2 = ConstructPoint(XCoordinate=number_slider_3, YCoordinate=number_slider_3, ZCoordinate=0)
addition_4 = Addition(A=addition_2, B=number_slider_5)
neg_3 = Negative(Value=addition_3)
Y_3 = UnitY(Factor=addition)
X = UnitX(Factor=number_slider)
neg_4 = Negative(Value=addition_4)

# ---- group: Printing Height
panel_3 = Panel(multiplication_2)

# ----
Y_4 = UnitY(Factor=addition_2)
X_2 = UnitX(Factor=number_slider_2)
Y_5 = UnitY(Factor=neg_3)
Y_6 = UnitY(Factor=neg_4)
move = Move(Geometry=pt, Motion=Y)  # -> Geometry, Transform
move_2 = Move(Geometry=pt, Motion=Y_3)  # -> Geometry, Transform
move_3 = Move(Geometry=move_2.Geometry, Motion=X)  # -> Geometry, Transform
move_4 = Move(Geometry=move_3.Geometry, Motion=Y_5)  # -> Geometry, Transform
move_5 = Move(Geometry=move_4.Geometry, Motion=X)  # -> Geometry, Transform
move_6 = Move(Geometry=pt_2, Motion=Y_2)  # -> Geometry, Transform
move_7 = Move(Geometry=pt_2, Motion=Y_4)  # -> Geometry, Transform
move_8 = Move(Geometry=move_7.Geometry, Motion=X_2)  # -> Geometry, Transform
move_9 = Move(Geometry=move_8.Geometry, Motion=Y_6)  # -> Geometry, Transform
move_10 = Move(Geometry=move_9.Geometry, Motion=X_2)  # -> Geometry, Transform
preview = CustomPreview(Geometry=crv, Shader=ColourSwatch(SwatchColor=RGB(255, 255, 255)))
integer_division = IntegerDivision(A=division, B="2")
integer_division_2 = IntegerDivision(A=division_2, B="2")
merge = Merge(Data1=move.Geometry, Data2=move_2.Geometry, Data3=move_3.Geometry, Data4=move_4.Geometry, Data5=move_5.Geometry)
multiplication_3 = Multiplication(A=number_slider, B="2")
merge_2 = Merge(Data1=move_6.Geometry, Data2=move_7.Geometry, Data3=move_8.Geometry, Data4=move_9.Geometry, Data5=move_10.Geometry)
multiplication_4 = Multiplication(A=number_slider_2, B="2")
series = Series(Start=0, Step=multiplication_3, Count=integer_division)
pline = PolyLine(Vertices=merge, Closed=False)
series_2 = Series(Start=0, Step=multiplication_4, Count=integer_division_2)
pline_2 = PolyLine(Vertices=merge_2, Closed=False)
X_3 = UnitX(Factor=series)
X_4 = UnitX(Factor=series_2)
move_11 = Move(Geometry=pline, Motion=X_3)  # -> Geometry, Transform
move_12 = Move(Geometry=pline_2, Motion=X_4)  # -> Geometry, Transform
join = JoinCurves(Curves=move_11.Geometry, Preserve=False)
join_2 = JoinCurves(Curves=move_12.Geometry, Preserve=False)
bbox = BoundingBox(Content=join, Plane=PlaneXY(0, 0, 0))  # -> Box, Box_2
bbox_2 = BoundingBox(Content=join_2, Plane=PlaneXY(0, 0, 0))  # -> Box, Box_2
area = Area(Geometry=bbox.Box_2)  # -> Area, Centroid
area_2 = Area(Geometry=bbox_2.Box_2)  # -> Area, Centroid
pdecon = Deconstruct(Point=area.Centroid)  # -> XComponent, YComponent, ZComponent
pdecon_2 = Deconstruct(Point=area_2.Centroid)  # -> XComponent, YComponent, ZComponent
pt_3 = ConstructPoint(XCoordinate=pdecon.XComponent, YCoordinate=pdecon.YComponent, ZCoordinate=0)
pt_4 = ConstructPoint(XCoordinate=pdecon_2.XComponent, YCoordinate=pdecon_2.YComponent, ZCoordinate=0)
rotate = Rotate(Geometry=join_2, Angle="0.5 * pi", Plane=pt_4)  # -> Geometry, Transform
merge_3 = Merge(Data1=join, Data2=join_2, Data3=rotate.Geometry)  # -> flatten(Result)
crv_3 = Curve(merge_3)
disc = Discontinuity(Curve=join, Level=1)  # -> Points, Parameters
shatter = Shatter(Curve=join, Parameters=disc.Parameters)
disc_2 = Discontinuity(Curve=join_2, Level=1)  # -> Points, Parameters
shatter_2 = Shatter(Curve=join_2, Parameters=disc_2.Parameters)
disc_3 = Discontinuity(Curve=rotate.Geometry, Level=1)  # -> Points, Parameters
shatter_3 = Shatter(Curve=rotate.Geometry, Parameters=disc_3.Parameters)
len = Length(Curve=shatter)
len_2 = Length(Curve=shatter_2)
lng = ListLength(List=len)
len_3 = Length(Curve=shatter_3)
lng_2 = ListLength(List=len_2)
pdecon_3 = Deconstruct(Point=disc.Points)  # -> XComponent, YComponent, ZComponent
pdecon_4 = Deconstruct(Point=disc_2.Points)  # -> XComponent, YComponent, ZComponent
pdecon_5 = Deconstruct(Point=disc_3.Points)  # -> XComponent, YComponent, ZComponent
panel_4 = Panel(lng)
panel_5 = Panel(lng_2)
lng_3 = ListLength(List=len_3)
lng_4 = ListLength(List=pdecon_3.XComponent)
panel_6 = Panel(lng_3)
lng_5 = ListLength(List=pdecon_4.XComponent)
lng_6 = ListLength(List=pdecon_5.XComponent)
ins = InsertItems(List=len, Item="0", Indices="0", Wrap=True)
ins_2 = InsertItems(List=len_2, Item="0", Indices="0", Wrap=True)
ins_3 = InsertItems(List=len_3, Item="0", Indices="0", Wrap=True)
panel_7 = Panel(ins)
panel_8 = Panel(ins_3)
panel_9 = Panel(ins_2)
number_slider_9 = Slider(5, range=0..10)
multiplication_5 = Multiplication(A=ins, B=Slider(5, range=0..10))
multiplication_6 = Multiplication(A=ins_2, B=number_slider_9)
multiplication_7 = Multiplication(A=ins_3, B=number_slider_9)
python = PythonScript(
    layer_count=number_slider_6,
    layer_height=number_slider_8,
    a_len=lng_5,
    a_x=pdecon_4.XComponent,
    a_y=pdecon_4.YComponent,
    a_e=multiplication_6,
    b_len=lng_6,
    b_x=pdecon_5.XComponent,
    b_y=pdecon_5.YComponent,
    b_e=multiplication_7)  # -> out, gcode; inputs layer_count: Int32, a_x: list, a_y: list, a_e: list, b_x: list, b_y: list, b_e: list
# ---------- python: Python ----------
gcode = []

z = 0
EA = 0
EB = 0

gcode.append("; Body") #F

for j in range(layer_count):
    
    z += layer_height
    gcode.append("G1 Z" + str(z) + " F4000") #F
    
    for i in range(a_len):
        EA += float(a_e[i])
        a_test = "G1 X" + str(a_x[i]) + " Y" + str(a_y[i]) + " E" + str(EA)
        gcode.append(a_test)

    EA = 0    
    gcode.append("G92 E0")

    
    
    z += layer_height
    gcode.append("G1 Z" + str(z))
    

    # gcode.append("; Hello")

    for i in range(b_len):
        EB += float(b_e[i])
        b_test = "G1 X" + str(b_x[i]) + " Y" + str(b_y[i]) + " E" + str(EB)
        gcode.append(b_test)
    
    EB = 0
    gcode.append("G92 E0")
# ---------- end python ----------
python_2 = PythonScript(layer_height=number_slider_7, a_len=lng_4, a_x=pdecon_3.XComponent, a_y=pdecon_3.YComponent, a_e=multiplication_5)  # -> out, gcode; inputs a_x: list, a_y: list, a_e: list
# ---------- python_2: Python ----------
gcode = []

EA = 0

gcode.append("; Skirt") #F


z = layer_height
gcode.append("G1 Z" + str(z) + " F4000") #F

for i in range(a_len):
    EA += float(a_e[i])
    a_test = "G1 X" + str(a_x[i]) + " Y" + str(a_y[i]) + " E" + str(EA)
    gcode.append(a_test)

EA = 0    
gcode.append("G92 E0")
# ---------- end python_2 ----------
panel_10 = Panel(python_2.gcode)
panel_12 = Panel(python.gcode)
panel_13 = Panel("""Hello World
Hello Python""")
txt = Text(python.gcode)
txt_2 = Text(python_2.gcode)

# ---- group: file_name
panel_14 = Panel("181019")

# ----
list = ValueList({"txt": 1, "gcode": 2}, selected="gcode")
button = Button()
gh_cpython = GH_CPython(PATH="C:\Users\yoshioca\Desktop\", File_Name=panel_14, File_Type=list, SKIRT=txt_2, MSG=txt, TF=button)  # -> a, debug; inputs PATH: list, File_Name: list, File_Type: list, SKIRT: list, MSG: list, TF: list
# ---------- gh_cpython: Python ----------
def TYPE(num):
    if num == 1:
        type = ".txt"
    elif num == 2:
        type = ".gcode"
    return type


debug = []

path_set = str(PATH)
file_name = str(File_Name)
file_type = TYPE(File_Type)
msg = MSG
skirt = SKIRT



#debug.append(MSG[1])

for i in xrange(len(skirt)):
    debug.append(skirt[i])
    debug.append("\n")

for i in xrange(len(msg)):
    debug.append(msg[i])
    if i < len(msg)-1:
        debug.append("\n")



path_out = path_set + "\\" + file_name + file_type

a = path_out


if TF:
    f = open(path_out, "w")
    f.writelines(debug)
    f.close
# ---------- end gh_cpython ----------
panel_15 = Panel(button)
panel_16 = Panel(gh_cpython.a)
panel_17 = Panel(gh_cpython.debug)
