# Grasshopper definition Write-gcode-ver3-Desktop.ghx (Grasshopper 0.9.76)
# plug-ins: Python Interpreter, GH_CPython

# ---- group: size
panel = Panel("60")

# ---- group: Grid
number_slider = Slider(4, range=0..100)

# ----
rectangle = Rectangle(Plane=PlaneXY(0, 0, 0), XSize="0 to 200", YSize="0 to 200", Radius=0)  # -> Rectangle, Length
crv = Curve(rectangle.Rectangle)

# ---- group: layer_height
number_slider_2 = Slider(0.2, range=0.1..30)

# ---- group: Margin
number_slider_3 = Slider(2, range=1..200)

# ---- group: layer_count
number_slider_4 = Slider(20, range=1..350)

# ---- group: W
number_slider_5 = Slider(8, range=0..100)

# ---- group: Helical-Cylinder / layer_height
number_slider_6 = Slider(0.2, range=0.1..30)

# ---- group: Loft-Surf / layer_height
number_slider_7 = Slider(0.2, range=0.1..30)

# ---- group: Helical-Cylinder / Margin
number_slider_8 = Slider(2, range=1..200)

# ----
number_slider_9 = Slider(40, range=0..1000)

# ---- group: Loft-Surf / Margin
number_slider_10 = Slider(2, range=1..200)

# ---- group: Helical-Cylinder / W
number_slider_11 = Slider(4, range=0..100)

# ---- group: Loft-Surf / W
number_slider_12 = Slider(4, range=0..100)

# ----
multiplication = Multiplication(A=number_slider_4, B=number_slider_2)
multiplication_2 = Multiplication(A=multiplication, B="2")

# ---- group: Printing Height
panel_2 = Panel(multiplication_2)

# ----
neg = Negative(Value=number_slider_3)
division = Division(A="65", B=number_slider_5)
addition = Addition(A=panel, B=number_slider_3)
division_2 = Division(A=panel, B=number_slider)
addition_2 = Addition(A=panel, B=number_slider_3)
Y = UnitY(Factor=neg)
pt = ConstructPoint(XCoordinate=Slider(40, range=0..1000), YCoordinate=Slider(150, range=0..1000), ZCoordinate=0)
addition_3 = Addition(A=addition, B=number_slider_3)
pt_2 = ConstructPoint(XCoordinate=number_slider_9, YCoordinate=number_slider_9, ZCoordinate=0)
neg_2 = Negative(Value=number_slider_3)
addition_4 = Addition(A=addition_2, B=number_slider_3)
neg_3 = Negative(Value=addition_3)
Y_2 = UnitY(Factor=addition)
X = UnitX(Factor=number_slider_5)
neg_4 = Negative(Value=addition_4)
Y_3 = UnitY(Factor=neg_2)
X_2 = UnitX(Factor=number_slider)
Y_4 = UnitY(Factor=addition_2)
Y_5 = UnitY(Factor=neg_3)
preview = CustomPreview(Geometry=crv, Shader=ColourSwatch(SwatchColor=RGB(255, 255, 255)))
Y_6 = UnitY(Factor=neg_4)
move = Move(Geometry=pt, Motion=Y)  # -> Geometry, Transform
move_2 = Move(Geometry=pt, Motion=Y_2)  # -> Geometry, Transform
move_3 = Move(Geometry=move_2.Geometry, Motion=X)  # -> Geometry, Transform
move_4 = Move(Geometry=move_3.Geometry, Motion=Y_5)  # -> Geometry, Transform
move_5 = Move(Geometry=move_4.Geometry, Motion=X)  # -> Geometry, Transform
move_6 = Move(Geometry=pt_2, Motion=Y_3)  # -> Geometry, Transform
move_7 = Move(Geometry=pt_2, Motion=Y_4)  # -> Geometry, Transform
move_8 = Move(Geometry=move_7.Geometry, Motion=X_2)  # -> Geometry, Transform
move_9 = Move(Geometry=move_8.Geometry, Motion=Y_6)  # -> Geometry, Transform
move_10 = Move(Geometry=move_9.Geometry, Motion=X_2)  # -> Geometry, Transform
integer_division = IntegerDivision(A=division, B="2")
integer_division_2 = IntegerDivision(A=division_2, B="2")
merge = Merge(Data1=move.Geometry, Data2=move_2.Geometry, Data3=move_3.Geometry, Data4=move_4.Geometry, Data5=move_5.Geometry)
multiplication_3 = Multiplication(A=number_slider_5, B="2")
multiplication_4 = Multiplication(A=number_slider, B="2")
merge_2 = Merge(Data1=move_6.Geometry, Data2=move_7.Geometry, Data3=move_8.Geometry, Data4=move_9.Geometry, Data5=move_10.Geometry)
series = Series(Start=0, Step=multiplication_3, Count=integer_division)
pline = PolyLine(Vertices=merge, Closed=False)
series_2 = Series(Start=0, Step=multiplication_4, Count=integer_division_2)
pline_2 = PolyLine(Vertices=merge_2, Closed=False)

# ---- group: Helical-Cylinder / layer_count
number_slider_13 = Slider(20, range=1..350)

# ---- group: Loft-Surf / layer_count
number_slider_14 = Slider(20, range=1..350)

# ----
X_3 = UnitX(Factor=series)
X_4 = UnitX(Factor=series_2)
move_11 = Move(Geometry=pline, Motion=X_3)  # -> Geometry, Transform
move_12 = Move(Geometry=pline_2, Motion=X_4)  # -> Geometry, Transform
vec2pt = Vector2Pt(PointA=move_6.Geometry, PointB=move_7.Geometry, Unitize=False)  # -> Vector, Length
join = JoinCurves(Curves=move_11.Geometry, Preserve=False)
join_2 = JoinCurves(Curves=move_12.Geometry, Preserve=False)
end = EndPoints(Curve=join_2)  # -> Start, End
move_13 = Move(Geometry=end.End, Motion=vec2pt.Vector)  # -> Geometry, Transform
ln = Line(StartPoint=end.End, EndPoint=move_13.Geometry)
merge_3 = Merge(Data1=join_2, Data2=ln)
join_3 = JoinCurves(Curves=merge_3, Preserve=False)
crv_2 = Curve(join_3)
Z = UnitZ(Factor=number_slider_2)
panel_3 = Panel(join_3)
move_14 = Move(Geometry=join, Motion=Z)  # -> Geometry, Transform
bbox = BoundingBox(Content=crv_2, Plane=PlaneXY(0, 0, 0))  # -> Box, Box_2
area = Area(Geometry=bbox.Box_2)  # -> Area, Centroid
pdecon = Deconstruct(Point=area.Centroid)  # -> XComponent, YComponent, ZComponent
pt_3 = ConstructPoint(XCoordinate=pdecon.XComponent, YCoordinate=pdecon.YComponent, ZCoordinate=0)
rotate = Rotate(Geometry=crv_2, Angle="0.5 * pi", Plane=pt_3)  # -> Geometry, Transform
merge_4 = Merge(Data2=crv_2, Data3=rotate.Geometry)  # -> flatten(Result)
crv_3 = Curve(merge_4)
crv_4 = Curve(rotate.Geometry)
disc = Discontinuity(Curve=crv_2, Level=1)  # -> Points, Parameters
viewer = ParamViewer(disc.Points)
multiplication_5 = Multiplication(A=number_slider_2, B="2")
crv_5 = Curve(move_14.Geometry)
series_3 = Series(Start=number_slider_2, Step=multiplication_5, Count=number_slider_4)
flatten = FlattenTree(Tree=crv_5, Path="{0}")
series_4 = Series(Start=multiplication_5, Step=multiplication_5, Count=number_slider_4)
Z_2 = UnitZ(Factor=series_3)
Z_3 = UnitZ(Factor=series_4)

# ---- group: Speed
number_slider_15 = Slider(1000, range=1000..5000)

# ----
move_15 = Move(Geometry=crv_2, Motion=Z_2)  # -> Geometry, Transform
move_16 = Move(Geometry=crv_4, Motion=Z_3)  # -> Geometry, Transform

# ---- group: Helical-Cylinder / Speed
number_slider_16 = Slider(1000, range=1000..5000)

# ---- group: Loft-Surf / Speed
number_slider_17 = Slider(1000, range=1000..5000)

# ---- group: amp
number_slider_18 = Slider(0.1, range=0..1)

# ----
graft = GraftTree(Tree=move_15.Geometry, IncludeEmptyLists=True, IncludeNullItems=True)
graft_2 = GraftTree(Tree=move_16.Geometry, IncludeEmptyLists=True, IncludeNullItems=True)
disc_2 = Discontinuity(Curve=flatten, Level=1)  # -> Points, Parameters
shift = ShiftList(List=disc_2.Points, Shift="1", Wrap=True)
panel_4 = Panel(disc_2.Points)
simplify = SimplifyTree(Tree=graft, Front=False)
simplify_2 = SimplifyTree(Tree=graft_2, Front=False)

# ---- group: Helical-Cylinder / amp
number_slider_19 = Slider(0.1, range=0..1)

# ---- group: Loft-Surf / amp
number_slider_20 = Slider(0.1, range=0..1)

# ----
pdecon_2 = Deconstruct(Point=disc_2.Points)  # -> XComponent, YComponent, ZComponent
dist = Distance(PointA=disc_2.Points, PointB=shift)
merge_5 = Merge(Data1=simplify, Data2=simplify_2)
num = Number(pdecon_2.YComponent)
num_2 = Number(pdecon_2.ZComponent)
num_3 = Number(pdecon_2.XComponent)
lng = ListLength(List=num_3)  # -> flatten(Length)
rev = ReverseList(List=dist)
flatten_2 = FlattenTree(Tree=num, Path="{0}")
flatten_3 = FlattenTree(Tree=num_2, Path="{0}")
flatten_4 = FlattenTree(Tree=num_3, Path="{0}")
split = SplitList(List=rev, Index="1")  # -> ListA, ListB
rev_2 = ReverseList(List=split.ListB)
crv_6 = Curve(merge_5)
ins = InsertItems(List=rev_2, Item="0", Indices="0", Wrap=True)
flatten_5 = FlattenTree(Tree=crv_6, Path="{0}")
flatten_6 = FlattenTree(Tree=ins, Path="{0}")  # -> simplify(Tree)
disc_3 = Discontinuity(Curve=flatten_5, Level=1)  # -> Points, Parameters
viewer_2 = ParamViewer(flatten_6)
multiplication_6 = Multiplication(A=flatten_6, B=number_slider_18)
panel_5 = Panel(lng)
panel_6 = Panel(disc_3.Points)
flip = FlipMatrix(Data=disc_3.Points)
python = PythonScript(x=flatten_4, y=flatten_2, z=flatten_3, e=multiplication_6, u=lng, speed=number_slider_15)  # -> out, a; inputs x: list, y: list, z: list, e: list, u: list
# ---------- python: Python ----------
_start = 0
_end = 0

gcode = []


gcode.append("; Skirt")
gcode.append("G1 Z30" + " F" + str(speed))


for i in xrange(len(u)):
    _end += u[i]
    extrude = 0
   

    se = "; layer " + str(i)# + ", " + str(_start) + "-" + str(_end)
    gcode.append(se)
    
    for j in xrange(_start, _end):
        extrude += float(e[j])
        z_tmp = float(z[0]) + 30
        text = "G1 X" + str(x[j]) + " Y" + str(y[j]) + " Z" + str(z[j]) + " E" + str(extrude)
        gcode.append(text)

    gcode.append("G1 Z " + str(z_tmp))
    gcode.append("G92 E0")
    #print(_start, _end)
    _start = _end + 1

    
a = gcode
# ---------- end python ----------
shift_2 = ShiftList(List=disc_3.Points, Shift="1", Wrap=True)
pdecon_3 = Deconstruct(Point=disc_3.Points)  # -> XComponent, YComponent, ZComponent
dist_2 = Distance(PointA=disc_3.Points, PointB=shift_2)
num_4 = Number(pdecon_3.YComponent)
num_5 = Number(pdecon_3.ZComponent)
num_6 = Number(pdecon_3.XComponent)
lng_2 = ListLength(List=num_6)  # -> flatten(Length)
rev_3 = ReverseList(List=dist_2)
flatten_7 = FlattenTree(Tree=num_4, Path="{0}")
flatten_8 = FlattenTree(Tree=num_5, Path="{0}")
flatten_9 = FlattenTree(Tree=num_6, Path="{0}")
panel_8 = Panel(python.a)
split_2 = SplitList(List=rev_3, Index="1")  # -> ListA, ListB
panel_9 = Panel(dist_2)
rev_4 = ReverseList(List=split_2.ListB)
multiplication_7 = Multiplication(A=number_slider_4, B="2")
item = ListItem(List=flatten_8, Index="-1", Wrap=True)
item_2 = ListItem(List=flatten_7, Index="-1", Wrap=True)
item_3 = ListItem(List=flatten_9, Index="-1", Wrap=True)
ins_2 = InsertItems(List=rev_4, Item="0", Indices="0", Wrap=True)
panel_10 = Panel(item_3)
flatten_10 = FlattenTree(Tree=ins_2, Path="{0}")  # -> simplify(Tree)
viewer_3 = ParamViewer(flatten_9)
multiplication_8 = Multiplication(A=flatten_10, B=number_slider_18)
panel_11 = Panel(lng_2)
item_4 = ListItem(List=multiplication_8, Index="-1", Wrap=True)
panel_12 = Panel(multiplication_8)
python_2 = PythonScript(x=flatten_9, y=flatten_7, z=flatten_8, e=multiplication_8, u=lng_2, speed=number_slider_15)  # -> out, a; inputs x: list, y: list, z: list, e: list, u: list
# ---------- python_2: Python ----------
_start = 0
_end = 0

x.append(120.0)
y.append(120.0)
z.append(120.0)
e.append(100.0)


gcode = []


gcode.append("; Body")
gcode.append("G1 Z30" + " F" + str(speed))


for i in xrange(len(u)):
    _end += u[i]


    se = "; layer " + str(i) + ": " + str(_start) + "-" + str(_end)
    gcode.append(se)
    extrude = 0
    
    for j in xrange(_start, _end):
        extrude += float(e[j])
        z_tmp = float(z[_end]) + 5
        text = "G1 X" + str(x[j]) + " Y" + str(y[j]) + " Z" + str(z[j]) + " E" + str(extrude)
        gcode.append(text)

    gcode.append("G1 Z " + str(z_tmp))
    gcode.append("G92 E0")
    _start = _end

    
a = gcode
# ---------- end python_2 ----------
panel_13 = Panel(item_4)
panel_14 = Panel("""G90
M82
M106 S0
M104 S190 T0
M109 S190 T0""")
panel_15 = Panel(python_2.a)
txt = Text(python.a)
txt_2 = Text(python_2.a)
list = ValueList({"txt": 1, "gcode": 2}, selected="gcode")

# ---- group: file_name
panel_16 = Panel("181029-slab-Desktop")

# ---- group: Helical-Cylinder / file_name
panel_17 = Panel("181105-slab-Desktop-Cylinder-Helical")

# ---- group: Helical-Cylinder
neg_5 = Negative(Value=number_slider_8)
division_3 = Division(A="24", B=number_slider_11)
addition_5 = Addition(A=Slider(100, range=0..100), B=number_slider_8)
Y_7 = UnitY(Factor=neg_5)
pt_4 = ConstructPoint(XCoordinate=Slider(20, range=0..1000), YCoordinate=Slider(20, range=0..1000), ZCoordinate=0)
addition_6 = Addition(A=addition_5, B=number_slider_8)
neg_6 = Negative(Value=addition_6)
Y_8 = UnitY(Factor=addition_5)
X_5 = UnitX(Factor=number_slider_11)
Y_9 = UnitY(Factor=neg_6)
move_17 = Move(Geometry=pt_4, Motion=Y_7)  # -> Geometry, Transform
move_18 = Move(Geometry=pt_4, Motion=Y_8)  # -> Geometry, Transform
move_19 = Move(Geometry=move_18.Geometry, Motion=X_5)  # -> Geometry, Transform
move_20 = Move(Geometry=move_19.Geometry, Motion=Y_9)  # -> Geometry, Transform
move_21 = Move(Geometry=move_20.Geometry, Motion=X_5)  # -> Geometry, Transform
integer_division_3 = IntegerDivision(A=division_3, B="2")
merge_6 = Merge(Data1=move_17.Geometry, Data2=move_18.Geometry, Data3=move_19.Geometry, Data4=move_20.Geometry, Data5=move_21.Geometry)
multiplication_9 = Multiplication(A=number_slider_11, B="2")
series_5 = Series(Start=0, Step=multiplication_9, Count=integer_division_3)
pline_3 = PolyLine(Vertices=merge_6, Closed=False)
X_6 = UnitX(Factor=series_5)
move_22 = Move(Geometry=pline_3, Motion=X_6)  # -> Geometry, Transform
join_4 = JoinCurves(Curves=move_22.Geometry, Preserve=False)
Z_4 = UnitZ(Factor=number_slider_6)
move_23 = Move(Geometry=join_4, Motion=Z_4)  # -> Geometry, Transform
number_slider_21 = Slider(20, range=0..100)
pdecon_4 = Deconstruct(Point="100, 100, 0")  # -> XComponent, YComponent, ZComponent
cir = Circle(Plane="100, 100, 0", Radius=number_slider_21)
Z_5 = UnitZ(Factor=Slider(0.2, range=0..1))
python_3 = PythonScript(x=pdecon_4.XComponent, y=pdecon_4.YComponent, r=number_slider_21, count=Slider(4, range=1..30))  # -> out, a
# ---------- python_3: Python ----------
import rhinoscriptsyntax as rs
import math

a = []
pos_z =0.35

for i in xrange(360*32):
    
    num = math.radians(i*count)
    
    pos_x = r*math.cos(num)+x
    pos_y = r*math.sin(num)+y
    z = 0.2*count/360.0*1.5 # amp
    pos_z += z
    
    point = rs.AddPoint(pos_x, pos_y, pos_z)
    a.append(point)
# ---------- end python_3 ----------
move_24 = Move(Geometry=cir, Motion=Z_5)  # -> Geometry, Transform
divide = DivideCurve(Curve=move_24.Geometry, Count="90", Kinks=False)  # -> Points, Tangents, Parameters
pline_4 = PolyLine(Vertices=python_3.a, Closed=False)
pline_5 = PolyLine(Vertices=divide.Points, Closed=Toggle(True))
crv_7 = Curve(move_23.Geometry)
flatten_11 = FlattenTree(Tree=crv_7, Path="{0}")
merge_7 = Merge(Data1=pline_5, Data2=pline_4)
disc_4 = Discontinuity(Curve=flatten_11, Level=1)  # -> Points, Parameters
crv_8 = Curve(merge_7)
shift_3 = ShiftList(List=disc_4.Points, Shift="1", Wrap=True)
panel_18 = Panel(disc_4.Points)
flatten_12 = FlattenTree(Tree=crv_8, Path="{0}")
viewer_4 = ParamViewer(flatten_12)
pdecon_5 = Deconstruct(Point=disc_4.Points)  # -> XComponent, YComponent, ZComponent
dist_3 = Distance(PointA=disc_4.Points, PointB=shift_3)
num_7 = Number(pdecon_5.YComponent)
num_8 = Number(pdecon_5.ZComponent)
num_9 = Number(pdecon_5.XComponent)
lng_3 = ListLength(List=num_9)  # -> flatten(Length)
rev_5 = ReverseList(List=dist_3)
flatten_13 = FlattenTree(Tree=num_7, Path="{0}")
flatten_14 = FlattenTree(Tree=num_8, Path="{0}")
flatten_15 = FlattenTree(Tree=num_9, Path="{0}")
disc_5 = Discontinuity(Curve=flatten_12, Level=1)  # -> Points, Parameters
split_3 = SplitList(List=rev_5, Index="1")  # -> ListA, ListB
viewer_5 = ParamViewer(disc_5.Points)
panel_19 = Panel(disc_5.Points)
rev_6 = ReverseList(List=split_3.ListB)
ins_3 = InsertItems(List=rev_6, Item="0", Indices="0", Wrap=True)
flip_2 = FlipMatrix(Data=disc_5.Points)
shift_4 = ShiftList(List=disc_5.Points, Shift="1", Wrap=True)
flatten_16 = FlattenTree(Tree=ins_3, Path="{0}")  # -> simplify(Tree)
pdecon_6 = Deconstruct(Point=disc_5.Points)  # -> XComponent, YComponent, ZComponent
viewer_6 = ParamViewer(flatten_16)
dist_4 = Distance(PointA=disc_5.Points, PointB=shift_4)
num_10 = Number(pdecon_6.YComponent)
num_11 = Number(pdecon_6.ZComponent)
num_12 = Number(pdecon_6.XComponent)
multiplication_10 = Multiplication(A=flatten_16, B=number_slider_19)
panel_20 = Panel(lng_3)
lng_4 = ListLength(List=num_12)  # -> flatten(Length)
rev_7 = ReverseList(List=dist_4)
flatten_17 = FlattenTree(Tree=num_10, Path="{0}")
flatten_18 = FlattenTree(Tree=num_11, Path="{0}")
flatten_19 = FlattenTree(Tree=num_12, Path="{0}")
python_4 = PythonScript(x=flatten_15, y=flatten_13, z=flatten_14, e=multiplication_10, u=lng_3, speed=number_slider_16)  # -> out, a; inputs x: list, y: list, z: list, e: list, u: list; same code as python
split_4 = SplitList(List=rev_7, Index="1")  # -> ListA, ListB
rev_8 = ReverseList(List=split_4.ListB)
item_5 = ListItem(List=flatten_18, Index="-1", Wrap=True)
item_6 = ListItem(List=flatten_17, Index="-1", Wrap=True)
item_7 = ListItem(List=flatten_19, Index="-1", Wrap=True)
ins_4 = InsertItems(List=rev_8, Item="0", Indices="0", Wrap=True)
panel_22 = Panel(item_7)
panel_23 = Panel(python_4.a)
flatten_20 = FlattenTree(Tree=ins_4, Path="{0}")  # -> simplify(Tree)
viewer_7 = ParamViewer(flatten_19)
multiplication_11 = Multiplication(A=flatten_20, B=number_slider_19)
panel_24 = Panel(lng_4)
multiplication_12 = Multiplication(A=number_slider_13, B="2")
item_8 = ListItem(List=multiplication_11, Index="-1", Wrap=True)
panel_25 = Panel(multiplication_11)
python_5 = PythonScript(x=flatten_19, y=flatten_17, z=flatten_18, e=multiplication_11, u=lng_4, speed=number_slider_16)  # -> out, a; inputs x: list, y: list, z: list, e: list, u: list
# ---------- python_5: Python ----------
_start = 0
_end = 0

x.append(120.0)
y.append(120.0)
z.append(125.0)
e.append(120.0)


gcode = []


gcode.append("; Body")
gcode.append("G1 Z30" + " F" + str(speed))


for i in xrange(len(u)):
    _end += u[i]


    se = "; layer " + str(i) + ": " + str(_start) + "-" + str(_end)
    gcode.append(se)
    extrude = 0
    
    for j in xrange(_start, _end):
        extrude += float(e[j])
        z_tmp = float(z[_end]) + 5
        text = "G1 X" + str(x[j]) + " Y" + str(y[j]) + " Z" + str(z[j]) + " E" + str(extrude)
        gcode.append(text)

    gcode.append("G1 Z " + str(z_tmp))
    gcode.append("G92 E0")
    _start = _end

    
a = gcode
# ---------- end python_5 ----------
panel_26 = Panel(item_8)
panel_27 = Panel(""";HelicalPrinting
;layerHeight 0.2mm*1.5
G90
M82
M106 S0
M104 S190 T0
M109 S190 T0""")
panel_28 = Panel(python_5.a)
txt_3 = Text(python_4.a)
txt_4 = Text(python_5.a)
list_2 = ValueList({"txt": 1, "gcode": 2}, selected="gcode")
button = Button()
export_gcode_component = GH_CPython(
    PATH="C:\Users\yoshioca\Desktop\",
    File_Name=panel_17,
    File_Type=list_2,
    layer_height=number_slider_6,
    layer_count=multiplication_12,
    extrude_amp=number_slider_19,
    HEADER=panel_27,
    SKIRT=txt_3,
    MSG=txt_4,
    TF=button)  # -> a, debug; inputs PATH: list, File_Name: list, File_Type: list, layer_height: list, layer_count: list, extrude_amp: list, HEADER: list, SKIRT: list, MSG: list, TF: list
# ---------- export_gcode_component: Python ----------
from datetime import datetime

def TYPE(num):
    if num == 1:
        type = ".txt"
    elif num == 2:
        type = ".gcode"
    return type


debug = []
comment = []

path_set = str(PATH)
file_name = str(File_Name)
file_type = TYPE(File_Type)
 


# HEADER gode
for i in xrange(len(HEADER)):
    debug.append(HEADER[i])
    debug.append("\n")

debug.append("\n")



# Skirt gode
for i in xrange(len(SKIRT)):
    debug.append(SKIRT[i])
    debug.append("\n")

debug.append("\n")


# Body gcode
for i in xrange(len(MSG)):
    debug.append(MSG[i])
    if i < len(MSG)-1:
        debug.append("\n")


path_out = path_set + "\\" + file_name + file_type

a = path_out

len = len(debug)

# for i in xrange(len):
#     print(debug[i])





if TF:
    now = "; Export Time - " + str(datetime.now().strftime("%Y/%m/%d %H:%M:%S"))
    comment.append(now)
    comment.append("\n")

    height = "; Layer Height(mm) - " + str(layer_height)
    comment.append(height)
    comment.append("\n")

    count = "; Layer Count - " + str(layer_count)
    comment.append(count)
    comment.append("\n")


    amp = "; Extrude Amp - " + str(extrude_amp)
    comment.append(amp)
    comment.append("\n")
    comment.append("\n")

    f = open(path_out, "w")
    f.writelines(comment)
    f.writelines(debug)
    f.close
# ---------- end export_gcode_component ----------
panel_29 = Panel(button)
panel_30 = Panel(export_gcode_component.a)
panel_31 = Panel(export_gcode_component.debug)

# ---- group: Loft-Surf / file_name
panel_32 = Panel("181029-slab-Desktop")

# ---- group: Loft-Surf
neg_7 = Negative(Value=number_slider_10)
division_4 = Division(A="24", B=number_slider_12)
addition_7 = Addition(A=Slider(100, range=0..100), B=number_slider_10)
Y_10 = UnitY(Factor=neg_7)
pt_5 = ConstructPoint(XCoordinate=Slider(20, range=0..1000), YCoordinate=Slider(20, range=0..1000), ZCoordinate=0)
addition_8 = Addition(A=addition_7, B=number_slider_10)
neg_8 = Negative(Value=addition_8)
Y_11 = UnitY(Factor=addition_7)
X_7 = UnitX(Factor=number_slider_12)
Y_12 = UnitY(Factor=neg_8)
crv_9 = Curve(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)
crv_10 = Curve(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)
move_25 = Move(Geometry=pt_5, Motion=Y_10)  # -> Geometry, Transform
move_26 = Move(Geometry=pt_5, Motion=Y_11)  # -> Geometry, Transform
move_27 = Move(Geometry=move_26.Geometry, Motion=X_7)  # -> Geometry, Transform
move_28 = Move(Geometry=move_27.Geometry, Motion=Y_12)  # -> Geometry, Transform
move_29 = Move(Geometry=move_28.Geometry, Motion=X_7)  # -> Geometry, Transform
loft = Loft(Curves=[crv_9, crv_10], Options={Adjust=False, Closed=False, LoftEnds=0, LoftSimp=0, LoftType=0, Rebuild=10, Refit=0.01})
integer_division_4 = IntegerDivision(A=division_4, B="2")
merge_8 = Merge(Data1=move_25.Geometry, Data2=move_26.Geometry, Data3=move_27.Geometry, Data4=move_28.Geometry, Data5=move_29.Geometry)
multiplication_13 = Multiplication(A=number_slider_12, B="2")
sdivide = DivideSurface(Surface=loft, UCount=Slider(11, range=0..100), VCount=Slider(27, range=0..100))  # -> Points, Normals, Parameters
flip_3 = FlipMatrix(Data=sdivide.Points)
flip_4 = FlipMatrix(Data=sdivide.Points)
flip_5 = FlipMatrix(Data=flip_3)
series_6 = Series(Start=0, Step=multiplication_13, Count=integer_division_4)
pline_6 = PolyLine(Vertices=merge_8, Closed=False)
dispatch = Dispatch(List=flip_4, DispatchPattern=[True, False])  # -> ListA, ListB
X_8 = UnitX(Factor=series_6)
dispatch_2 = Dispatch(List=flip_5, DispatchPattern=[True, False])  # -> ListA, ListB
flip_6 = FlipMatrix(Data=dispatch.ListA)
flip_7 = FlipMatrix(Data=dispatch.ListB)
move_30 = Move(Geometry=pline_6, Motion=X_8)  # -> Geometry, Transform
flip_8 = FlipMatrix(Data=dispatch_2.ListA)
flip_9 = FlipMatrix(Data=dispatch_2.ListB)
join_5 = JoinCurves(Curves=move_30.Geometry, Preserve=False)
rev_9 = ReverseList(List=flip_7)
viewer_8 = ParamViewer(flip_6)
rev_10 = ReverseList(List=flip_9)
merge_9 = Merge(Data1=flip_6, Data2=rev_9)  # -> flatten(Result)
merge_10 = Merge(Data1=flip_8, Data2=rev_10)  # -> flatten(Result)
pline_7 = PolyLine(Vertices=merge_9, Closed=False)
pline_8 = PolyLine(Vertices=merge_10, Closed=False)
number_slider_22 = Slider(0.2, range=0..1)
Z_6 = UnitZ(Factor=number_slider_7)
merge_11 = Merge(Data1=pline_7, Data2=pline_8, Data3=pline_7, Data4=pline_8)
move_31 = Move(Geometry=join_5, Motion=Z_6)  # -> Geometry, Transform
series_7 = Series(Start=number_slider_22, Step=number_slider_22, Count=Slider(4, range=0..10))
Z_7 = UnitZ(Factor=series_7)
crv_11 = Curve(move_31.Geometry)
move_32 = Move(Geometry=merge_11, Motion=Z_7)  # -> Geometry, Transform
flatten_21 = FlattenTree(Tree=crv_11, Path="{0}")
disc_6 = Discontinuity(Curve=flatten_21, Level=1)  # -> Points, Parameters
crv_12 = Curve(move_32.Geometry)
shift_5 = ShiftList(List=disc_6.Points, Shift="1", Wrap=True)
panel_33 = Panel(disc_6.Points)
flatten_22 = FlattenTree(Tree=crv_12, Path="{0}")
pdecon_7 = Deconstruct(Point=disc_6.Points)  # -> XComponent, YComponent, ZComponent
dist_5 = Distance(PointA=disc_6.Points, PointB=shift_5)
num_13 = Number(pdecon_7.YComponent)
num_14 = Number(pdecon_7.ZComponent)
num_15 = Number(pdecon_7.XComponent)
lng_5 = ListLength(List=num_15)  # -> flatten(Length)
rev_11 = ReverseList(List=dist_5)
flatten_23 = FlattenTree(Tree=num_13, Path="{0}")
flatten_24 = FlattenTree(Tree=num_14, Path="{0}")
flatten_25 = FlattenTree(Tree=num_15, Path="{0}")
disc_7 = Discontinuity(Curve=flatten_22, Level=1)  # -> Points, Parameters
split_5 = SplitList(List=rev_11, Index="1")  # -> ListA, ListB
panel_34 = Panel(disc_7.Points)
rev_12 = ReverseList(List=split_5.ListB)
ins_5 = InsertItems(List=rev_12, Item="0", Indices="0", Wrap=True)
flip_10 = FlipMatrix(Data=disc_7.Points)
shift_6 = ShiftList(List=disc_7.Points, Shift="1", Wrap=True)
flatten_26 = FlattenTree(Tree=ins_5, Path="{0}")  # -> simplify(Tree)
pdecon_8 = Deconstruct(Point=disc_7.Points)  # -> XComponent, YComponent, ZComponent
viewer_9 = ParamViewer(flatten_26)
dist_6 = Distance(PointA=disc_7.Points, PointB=shift_6)
num_16 = Number(pdecon_8.YComponent)
num_17 = Number(pdecon_8.ZComponent)
num_18 = Number(pdecon_8.XComponent)
multiplication_14 = Multiplication(A=flatten_26, B=number_slider_20)
panel_35 = Panel(lng_5)
lng_6 = ListLength(List=num_18)  # -> flatten(Length)
rev_13 = ReverseList(List=dist_6)
flatten_27 = FlattenTree(Tree=num_16, Path="{0}")
flatten_28 = FlattenTree(Tree=num_17, Path="{0}")
flatten_29 = FlattenTree(Tree=num_18, Path="{0}")
python_6 = PythonScript(x=flatten_25, y=flatten_23, z=flatten_24, e=multiplication_14, u=lng_5, speed=number_slider_17)  # -> out, a; inputs x: list, y: list, z: list, e: list, u: list; same code as python
split_6 = SplitList(List=rev_13, Index="1")  # -> ListA, ListB
panel_36 = Panel("-1")
rev_14 = ReverseList(List=split_6.ListB)
ins_6 = InsertItems(List=rev_14, Item="0", Indices="0", Wrap=True)
panel_38 = Panel(python_6.a)
flatten_30 = FlattenTree(Tree=ins_6, Path="{0}")  # -> simplify(Tree)
viewer_10 = ParamViewer(flatten_29)
multiplication_15 = Multiplication(A=flatten_30, B=number_slider_20)
multiplication_16 = Multiplication(A=number_slider_14, B="2")
panel_39 = Panel(multiplication_15)
python_7 = PythonScript(x=flatten_29, y=flatten_27, z=flatten_28, e=multiplication_15, u=lng_6, speed=number_slider_17)  # -> out, a; inputs x: list, y: list, z: list, e: list, u: list; same code as python_5
panel_40 = Panel("""G90
M82
M106 S0
M104 S190 T0
M109 S190 T0""")
panel_41 = Panel(python_7.a)
txt_5 = Text(python_6.a)
txt_6 = Text(python_7.a)
list_3 = ValueList({"txt": 1, "gcode": 2}, selected="gcode")
button_2 = Button()
export_gcode_component_2 = GH_CPython(
    PATH="C:\Users\yoshioca\Desktop\",
    File_Name=panel_32,
    File_Type=list_3,
    layer_height=number_slider_7,
    layer_count=multiplication_16,
    extrude_amp=number_slider_20,
    HEADER=panel_40,
    SKIRT=txt_5,
    MSG=txt_6,
    TF=button_2)  # -> a, debug; inputs PATH: list, File_Name: list, File_Type: list, layer_height: list, layer_count: list, extrude_amp: list, HEADER: list, SKIRT: list, MSG: list, TF: list; same code as export_gcode_component
panel_42 = Panel(button_2)
panel_43 = Panel(export_gcode_component_2.a)
panel_44 = Panel(export_gcode_component_2.debug)

# ----
button_3 = Button()
export_gcode_component_3 = GH_CPython(
    PATH="C:\Users\yoshioca\Desktop\",
    File_Name=panel_16,
    File_Type=list,
    layer_height=number_slider_2,
    layer_count=multiplication_7,
    extrude_amp=number_slider_18,
    HEADER=panel_14,
    SKIRT=txt,
    MSG=txt_2,
    TF=button_3)  # -> a, debug; inputs PATH: list, File_Name: list, File_Type: list, layer_height: list, layer_count: list, extrude_amp: list, HEADER: list, SKIRT: list, MSG: list, TF: list
# ---------- export_gcode_component_3: Python ----------
from datetime import datetime

def TYPE(num):
    if num == 1:
        type = ".txt"
    elif num == 2:
        type = ".gcode"
    return type


debug = []
comment = []

path_set = str(PATH)
file_name = str(File_Name)
file_type = TYPE(File_Type)
 


# HEADER gode
for i in xrange(len(HEADER)):
    debug.append(HEADER[i])
    debug.append("\n")

debug.append("\n")



# Skirt gode
##for i in xrange(len(SKIRT)):
##    debug.append(SKIRT[i])
##    debug.append("\n")

##debug.append("\n")


# Body gcode
for i in xrange(len(MSG)):
    debug.append(MSG[i])
    if i < len(MSG)-1:
        debug.append("\n")


path_out = path_set + "\\" + file_name + file_type

a = path_out

len = len(debug)

# for i in xrange(len):
#     print(debug[i])





if TF:
    now = "; Export Time - " + str(datetime.now().strftime("%Y/%m/%d %H:%M:%S"))
    comment.append(now)
    comment.append("\n")

    height = "; Layer Height(mm) - " + str(layer_height)
    comment.append(height)
    comment.append("\n")

    count = "; Layer Count - " + str(layer_count)
    comment.append(count)
    comment.append("\n")


    amp = "; Extrude Amp - " + str(extrude_amp)
    comment.append(amp)
    comment.append("\n")
    comment.append("\n")

    f = open(path_out, "w")
    f.writelines(comment)
    f.writelines(debug)
    f.close
# ---------- end export_gcode_component_3 ----------
panel_45 = Panel(button_3)
panel_46 = Panel(export_gcode_component_3.a)
panel_47 = Panel(export_gcode_component_3.debug)
