# Grasshopper definition Write-gcode-ver4-Hard-Soft.ghx (Grasshopper 0.9.76)
# plug-ins: Python Interpreter, GH_CPython

# ---- group: size
panel = Panel("200")

# ----
rectangle = Rectangle(Plane=PlaneXY(0, 0, 0), XSize="0 to 800", YSize="0 to 800", Radius=0)  # -> Rectangle, Length
crv = Curve(rectangle.Rectangle)

# ---- group: Grid
number_slider = Slider(20, range=0..100)

# ---- group: layer_height
number_slider_2 = Slider(1.5, range=0.1..30)

# ---- group: Margin
number_slider_3 = Slider(20, range=1..200)

# ----
rectangle_2 = Rectangle(Plane=PlaneXY(0, 0, 0), XSize="0 to 800", YSize="0 to 800", Radius=0)  # -> Rectangle, Length
crv_2 = Curve(rectangle_2.Rectangle)

# ---- group: layer_count
number_slider_4 = Slider(15, range=1..350)

# ----
number_slider_5 = Slider(150, range=0..1000)
multiplication = Multiplication(A=number_slider_4, B=number_slider_2)

# ---- group: size
panel_2 = Panel("200")

# ---- group: Grid
number_slider_6 = Slider(20, range=0..100)

# ---- group: layer_height
number_slider_7 = Slider(1.5, range=0.1..30)

# ---- group: Margin
number_slider_8 = Slider(20, range=1..200)

# ---- group: layer_count
number_slider_9 = Slider(15, range=1..350)

# ----
multiplication_2 = Multiplication(A=multiplication, B="2")

# ---- group: Printing Height
panel_3 = Panel(multiplication_2)

# ----
number_slider_10 = Slider(150, range=0..1000)
multiplication_3 = Multiplication(A=number_slider_9, B=number_slider_7)
multiplication_4 = Multiplication(A=multiplication_3, B="2")

# ---- group: Printing Height
panel_4 = Panel(multiplication_4)

# ----
division = Division(A=panel, B=number_slider)
addition = Addition(A=panel, B=number_slider_3)
pt = ConstructPoint(XCoordinate=number_slider_5, YCoordinate=number_slider_5, ZCoordinate=0)
neg = Negative(Value=number_slider_3)
addition_2 = Addition(A=addition, B=number_slider_3)
division_2 = Division(A=panel_2, B=number_slider_6)
addition_3 = Addition(A=panel_2, B=number_slider_8)
neg_2 = Negative(Value=addition_2)
Y = UnitY(Factor=neg)
X = UnitX(Factor=number_slider)
Y_2 = UnitY(Factor=addition)
preview = CustomPreview(Geometry=crv, Shader=ColourSwatch(SwatchColor=RGB(255, 255, 255)))
Y_3 = UnitY(Factor=neg_2)
pt_2 = ConstructPoint(XCoordinate=number_slider_10, YCoordinate=number_slider_10, ZCoordinate=0)
preview_2 = CustomPreview(Geometry=crv_2, Shader=ColourSwatch(SwatchColor=RGB(255, 255, 255)))
neg_3 = Negative(Value=number_slider_8)
addition_4 = Addition(A=addition_3, B=number_slider_8)
neg_4 = Negative(Value=addition_4)
Y_4 = UnitY(Factor=neg_3)
X_2 = UnitX(Factor=number_slider_6)
Y_5 = UnitY(Factor=addition_3)
Y_6 = UnitY(Factor=neg_4)
crv_3 = Curve(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)
move = Move(Geometry=pt, Motion=Y)  # -> Geometry, Transform
move_2 = Move(Geometry=pt, Motion=Y_2)  # -> Geometry, Transform
move_3 = Move(Geometry=move_2.Geometry, Motion=X)  # -> Geometry, Transform
move_4 = Move(Geometry=move_3.Geometry, Motion=Y_3)  # -> Geometry, Transform
move_5 = Move(Geometry=move_4.Geometry, Motion=X)  # -> Geometry, Transform
integer_division = IntegerDivision(A=division, B="2")
crv_4 = Curve(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)
move_6 = Move(Geometry=pt_2, Motion=Y_4)  # -> Geometry, Transform
move_7 = Move(Geometry=pt_2, Motion=Y_5)  # -> Geometry, Transform
move_8 = Move(Geometry=move_7.Geometry, Motion=X_2)  # -> Geometry, Transform
move_9 = Move(Geometry=move_8.Geometry, Motion=Y_6)  # -> Geometry, Transform
move_10 = Move(Geometry=move_9.Geometry, Motion=X_2)  # -> Geometry, Transform
flatten = FlattenTree(Tree=crv_3, Path="{0}")
multiplication_5 = Multiplication(A=number_slider, B="2")
integer_division_2 = IntegerDivision(A=division_2, B="2")
merge = Merge(Data1=move.Geometry, Data2=move_2.Geometry, Data3=move_3.Geometry, Data4=move_4.Geometry, Data5=move_5.Geometry)
disc = Discontinuity(Curve=flatten, Level=1)  # -> Points, Parameters
flatten_2 = FlattenTree(Tree=crv_4, Path="{0}")
multiplication_6 = Multiplication(A=number_slider_6, B="2")
series = Series(Start=0, Step=multiplication_5, Count=integer_division)
pline = PolyLine(Vertices=merge, Closed=False)
merge_2 = Merge(Data1=move_6.Geometry, Data2=move_7.Geometry, Data3=move_8.Geometry, Data4=move_9.Geometry, Data5=move_10.Geometry)
disc_2 = Discontinuity(Curve=flatten_2, Level=1)  # -> Points, Parameters
X_3 = UnitX(Factor=series)
panel_5 = Panel(disc.Points)
shift = ShiftList(List=disc.Points, Shift="1", Wrap=True)
pdecon = Deconstruct(Point=disc.Points)  # -> XComponent, YComponent, ZComponent
series_2 = Series(Start=0, Step=multiplication_6, Count=integer_division_2)
move_11 = Move(Geometry=pline, Motion=X_3)  # -> Geometry, Transform
pline_2 = PolyLine(Vertices=merge_2, Closed=False)
dist = Distance(PointA=disc.Points, PointB=shift)
vec2pt = Vector2Pt(PointA=move.Geometry, PointB=move_2.Geometry, Unitize=False)  # -> Vector, Length
X_4 = UnitX(Factor=series_2)
num = Number(pdecon.YComponent)
num_2 = Number(pdecon.ZComponent)
num_3 = Number(pdecon.XComponent)
shift_2 = ShiftList(List=disc_2.Points, Shift="1", Wrap=True)
panel_6 = Panel(disc_2.Points)
join = JoinCurves(Curves=move_11.Geometry, Preserve=False)
rev = ReverseList(List=dist)
lng = ListLength(List=num_3)  # -> flatten(Length)
pdecon_2 = Deconstruct(Point=disc_2.Points)  # -> XComponent, YComponent, ZComponent
flatten_3 = FlattenTree(Tree=num, Path="{0}")
flatten_4 = FlattenTree(Tree=num_2, Path="{0}")
flatten_5 = FlattenTree(Tree=num_3, Path="{0}")
end = EndPoints(Curve=join)  # -> Start, End
move_12 = Move(Geometry=end.End, Motion=vec2pt.Vector)  # -> Geometry, Transform
move_13 = Move(Geometry=pline_2, Motion=X_4)  # -> Geometry, Transform
dist_2 = Distance(PointA=disc_2.Points, PointB=shift_2)

# ---- group: Speed
number_slider_11 = Slider(4500, range=2000..5000)

# ----
split = SplitList(List=rev, Index="1")  # -> ListA, ListB
vec2pt_2 = Vector2Pt(PointA=move_6.Geometry, PointB=move_7.Geometry, Unitize=False)  # -> Vector, Length
num_4 = Number(pdecon_2.YComponent)
num_5 = Number(pdecon_2.ZComponent)
num_6 = Number(pdecon_2.XComponent)
ln = Line(StartPoint=end.End, EndPoint=move_12.Geometry)
join_2 = JoinCurves(Curves=move_13.Geometry, Preserve=False)
rev_2 = ReverseList(List=dist_2)
merge_3 = Merge(Data1=join, Data2=ln)
lng_2 = ListLength(List=num_6)  # -> flatten(Length)
rev_3 = ReverseList(List=split.ListB)
flatten_6 = FlattenTree(Tree=num_4, Path="{0}")
flatten_7 = FlattenTree(Tree=num_5, Path="{0}")
flatten_8 = FlattenTree(Tree=num_6, Path="{0}")
end_2 = EndPoints(Curve=join_2)  # -> Start, End
move_14 = Move(Geometry=end_2.End, Motion=vec2pt_2.Vector)  # -> Geometry, Transform

# ---- group: Speed
number_slider_12 = Slider(4500, range=2000..5000)

# ----
split_2 = SplitList(List=rev_2, Index="1")  # -> ListA, ListB
join_3 = JoinCurves(Curves=merge_3, Preserve=False)
ins = InsertItems(List=rev_3, Item="0", Indices="0", Wrap=True)
ln_2 = Line(StartPoint=end_2.End, EndPoint=move_14.Geometry)
merge_4 = Merge(Data1=join_2, Data2=ln_2)
rev_4 = ReverseList(List=split_2.ListB)
crv_5 = Curve(join_3)
flatten_9 = FlattenTree(Tree=ins, Path="{0}")  # -> simplify(Tree)
panel_7 = Panel(join_3)

# ---- group: amp
number_slider_13 = Slider(8, range=1..10)

# ----
join_4 = JoinCurves(Curves=merge_4, Preserve=False)
ins_2 = InsertItems(List=rev_4, Item="0", Indices="0", Wrap=True)
panel_8 = Panel(lng)
bbox = BoundingBox(Content=crv_5, Plane=PlaneXY(0, 0, 0))  # -> Box, Box_2
viewer = ParamViewer(flatten_9)
crv_6 = Curve(join_4)
flatten_10 = FlattenTree(Tree=ins_2, Path="{0}")  # -> simplify(Tree)
multiplication_7 = Multiplication(A=flatten_9, B=number_slider_13)
panel_9 = Panel(join_4)
area = Area(Geometry=bbox.Box_2)  # -> Area, Centroid

# ---- group: amp
number_slider_14 = Slider(8, range=1..10)

# ----
pdecon_3 = Deconstruct(Point=area.Centroid)  # -> XComponent, YComponent, ZComponent
panel_10 = Panel(lng_2)
bbox_2 = BoundingBox(Content=crv_6, Plane=PlaneXY(0, 0, 0))  # -> Box, Box_2
viewer_2 = ParamViewer(flatten_10)
python = PythonScript(x=flatten_5, y=flatten_3, z=flatten_4, e=multiplication_7, u=lng, speed=number_slider_11)  # -> out, a; inputs x: list, y: list, z: list, e: list, u: list
# ---------- python: Python ----------
_start = 0
_end = 0

gcode = []


gcode.append("; Skirt")
gcode.append("G1 Z30" + " F" + str(speed))


for i in xrange(len(u)):
    _end += u[i]
    extrude = 0
   

    se = "; layer " + str(i)# + ", " + str(_start) + "-" + str(_end)
    gcode.append(se)
    
    for j in xrange(_start, _end):
        extrude += float(e[j])
        z_tmp = float(z[0]) + 30
        text = "G1 X" + str(x[j]) + " Y" + str(y[j]) + " Z" + str(z[j]) + " E" + str(extrude)
        gcode.append(text)

    gcode.append("G1 Z " + str(z_tmp))
    gcode.append("G92 E0")
    #print(_start, _end)
    _start = _end + 1

    
a = gcode
# ---------- end python ----------
pt_3 = ConstructPoint(XCoordinate=pdecon_3.XComponent, YCoordinate=pdecon_3.YComponent, ZCoordinate=0)
multiplication_8 = Multiplication(A=flatten_10, B=number_slider_14)
area_2 = Area(Geometry=bbox_2.Box_2)  # -> Area, Centroid
rotate = Rotate(Geometry=crv_5, Angle="0.5 * pi", Plane=pt_3)  # -> Geometry, Transform
merge_5 = Merge(Data1=crv_3, Data2=crv_5, Data3=rotate.Geometry)  # -> flatten(Result)
crv_7 = Curve(merge_5)
pdecon_4 = Deconstruct(Point=area_2.Centroid)  # -> XComponent, YComponent, ZComponent
python_2 = PythonScript(x=flatten_8, y=flatten_6, z=flatten_7, e=multiplication_8, u=lng_2, speed=number_slider_12)  # -> out, a; inputs x: list, y: list, z: list, e: list, u: list; same code as python
pt_4 = ConstructPoint(XCoordinate=pdecon_4.XComponent, YCoordinate=pdecon_4.YComponent, ZCoordinate=0)
crv_8 = Curve(rotate.Geometry)
disc_3 = Discontinuity(Curve=crv_5, Level=1)  # -> Points, Parameters
rotate_2 = Rotate(Geometry=crv_6, Angle="0.5 * pi", Plane=pt_4)  # -> Geometry, Transform
merge_6 = Merge(Data1=crv_4, Data2=crv_6, Data3=rotate_2.Geometry)  # -> flatten(Result)
crv_9 = Curve(merge_6)
crv_10 = Curve(rotate_2.Geometry)
viewer_3 = ParamViewer(disc_3.Points)
disc_4 = Discontinuity(Curve=crv_6, Level=1)  # -> Points, Parameters
multiplication_9 = Multiplication(A=number_slider_2, B="2")
series_3 = Series(Start=number_slider_2, Step=multiplication_9, Count=number_slider_4)
series_4 = Series(Start=multiplication_9, Step=multiplication_9, Count=number_slider_4)
viewer_4 = ParamViewer(disc_4.Points)
multiplication_10 = Multiplication(A=number_slider_7, B="2")
Z = UnitZ(Factor=series_3)
Z_2 = UnitZ(Factor=series_4)
series_5 = Series(Start=number_slider_7, Step=multiplication_10, Count=number_slider_9)
move_15 = Move(Geometry=crv_5, Motion=Z)  # -> Geometry, Transform
series_6 = Series(Start=multiplication_10, Step=multiplication_10, Count=number_slider_9)
move_16 = Move(Geometry=crv_8, Motion=Z_2)  # -> Geometry, Transform
Z_3 = UnitZ(Factor=series_5)
graft = GraftTree(Tree=move_15.Geometry, IncludeEmptyLists=True, IncludeNullItems=True)
Z_4 = UnitZ(Factor=series_6)
graft_2 = GraftTree(Tree=move_16.Geometry, IncludeEmptyLists=True, IncludeNullItems=True)
move_17 = Move(Geometry=crv_6, Motion=Z_3)  # -> Geometry, Transform
simplify = SimplifyTree(Tree=graft, Front=False)
move_18 = Move(Geometry=crv_10, Motion=Z_4)  # -> Geometry, Transform
simplify_2 = SimplifyTree(Tree=graft_2, Front=False)
graft_3 = GraftTree(Tree=move_17.Geometry, IncludeEmptyLists=True, IncludeNullItems=True)
graft_4 = GraftTree(Tree=move_18.Geometry, IncludeEmptyLists=True, IncludeNullItems=True)
merge_7 = Merge(Data1=simplify, Data2=simplify_2)
simplify_3 = SimplifyTree(Tree=graft_3, Front=False)
simplify_4 = SimplifyTree(Tree=graft_4, Front=False)
panel_11 = Panel(python.a)
crv_11 = Curve(merge_7)
dispatch = Dispatch(DispatchPattern=[True, False])  # -> ListA, ListB
merge_8 = Merge(Data1=simplify_3, Data2=simplify_4)
flatten_11 = FlattenTree(Tree=crv_11, Path="{0}")
panel_12 = Panel(python_2.a)
number_slider_15 = Slider(10, range=0..10)
flip = FlipMatrix(Data=merge_8)
crv_12 = Curve(merge_8)
crv_13 = Curve(flatten_11)
dispatch_2 = Dispatch(List=flip, DispatchPattern=[True, False])  # -> ListA, ListB
vec = VectorXYZ(XComponent=number_slider_15, YComponent=number_slider_15, ZComponent=0)  # -> Vector, Length
disc_5 = Discontinuity(Curve=crv_13, Level=1)  # -> Points, Parameters
move_19 = Move(Geometry=dispatch_2.ListB, Motion=vec.Vector)  # -> Geometry, Transform
merge_9 = Merge(Data1=dispatch_2.ListA, Data2=move_19.Geometry)
crv_14 = Curve(merge_9)
flatten_12 = FlattenTree(Tree=crv_14, Path="{0}")
end_3 = EndPoints(Curve=flatten_12)  # -> Start, End
pdecon_5 = Deconstruct(Point=end_3.Start)  # -> XComponent, YComponent, ZComponent
sort = SortList(Keys=pdecon_5.ZComponent, ValuesA=flatten_12)  # -> Keys, ValuesA
panel_13 = Panel(pdecon_5.ZComponent)
crv_15 = Curve(sort.ValuesA)
end_4 = EndPoints(Curve=crv_15)  # -> Start, End
pdecon_6 = Deconstruct(Point=end_4.Start)  # -> XComponent, YComponent, ZComponent
viewer_5 = ParamViewer(flatten_12)
panel_14 = Panel(disc_5.Points)
panel_15 = Panel(pdecon_6.ZComponent)
item = ListItem(List=crv_15, Index=Slider(1, range=0..30), Wrap=True)  # -> Item, Item1, Item2, Item3, Item4
disc_6 = Discontinuity(Curve=flatten_12, Level=1)  # -> Points, Parameters
flip_2 = FlipMatrix(Data=disc_5.Points)
pipe = Pipe(Curve=item.Item2, Radius=1, Caps=0)
pipe_2 = Pipe(Curve=item.Item4, Radius=1, Caps=0)
shift_3 = ShiftList(List=disc_5.Points, Shift="1", Wrap=True)
pipe_3 = Pipe(Curve=item.Item, Radius=1, Caps=0)
panel_17 = Panel(disc_6.Points)
pdecon_7 = Deconstruct(Point=disc_5.Points)  # -> XComponent, YComponent, ZComponent
flip_3 = FlipMatrix(Data=disc_6.Points)
dist_3 = Distance(PointA=disc_5.Points, PointB=shift_3)
num_7 = Number(pdecon_7.YComponent)
num_8 = Number(pdecon_7.ZComponent)
num_9 = Number(pdecon_7.XComponent)
shift_4 = ShiftList(List=disc_6.Points, Shift="1", Wrap=True)
lng_3 = ListLength(List=num_9)  # -> flatten(Length)
rev_5 = ReverseList(List=dist_3)
pdecon_8 = Deconstruct(Point=disc_6.Points)  # -> XComponent, YComponent, ZComponent
flatten_13 = FlattenTree(Tree=num_7, Path="{0}")
flatten_14 = FlattenTree(Tree=num_8, Path="{0}")
flatten_15 = FlattenTree(Tree=num_9, Path="{0}")
dist_4 = Distance(PointA=disc_6.Points, PointB=shift_4)
split_3 = SplitList(List=rev_5, Index="1")  # -> ListA, ListB
panel_19 = Panel(dist_3)
num_10 = Number(pdecon_8.YComponent)
num_11 = Number(pdecon_8.ZComponent)
num_12 = Number(pdecon_8.XComponent)
lng_4 = ListLength(List=num_12)  # -> flatten(Length)
rev_6 = ReverseList(List=dist_4)
rev_7 = ReverseList(List=split_3.ListB)
flatten_16 = FlattenTree(Tree=num_10, Path="{0}")
flatten_17 = FlattenTree(Tree=num_11, Path="{0}")
flatten_18 = FlattenTree(Tree=num_12, Path="{0}")
split_4 = SplitList(List=rev_6, Index="1")  # -> ListA, ListB
multiplication_11 = Multiplication(A=number_slider_4, B="2")
panel_20 = Panel(dist_4)
item_2 = ListItem(List=flatten_14, Index="-1", Wrap=True)
item_3 = ListItem(List=flatten_13, Index="-1", Wrap=True)
item_4 = ListItem(List=flatten_15, Index="-1", Wrap=True)
ins_3 = InsertItems(List=rev_7, Item="0", Indices="0", Wrap=True)
panel_21 = Panel(item_4)
rev_8 = ReverseList(List=split_4.ListB)
flatten_19 = FlattenTree(Tree=ins_3, Path="{0}")  # -> simplify(Tree)
viewer_6 = ParamViewer(flatten_15)
multiplication_12 = Multiplication(A=number_slider_9, B="2")
item_5 = ListItem(List=flatten_17, Index="-1", Wrap=True)
item_6 = ListItem(List=flatten_16, Index="-1", Wrap=True)
item_7 = ListItem(List=flatten_18, Index="-1", Wrap=True)
ins_4 = InsertItems(List=rev_8, Item="0", Indices="0", Wrap=True)
multiplication_13 = Multiplication(A=flatten_19, B=number_slider_13)
panel_22 = Panel(lng_3)
panel_23 = Panel(item_7)
flatten_20 = FlattenTree(Tree=ins_4, Path="{0}")  # -> simplify(Tree)
viewer_7 = ParamViewer(flatten_18)
item_8 = ListItem(List=multiplication_13, Index="-1", Wrap=True)
multiplication_14 = Multiplication(A=flatten_20, B=number_slider_14)
panel_24 = Panel(lng_4)
panel_25 = Panel(multiplication_13)
python_3 = PythonScript(x=flatten_15, y=flatten_13, z=flatten_14, e=multiplication_13, u=lng_3, speed=number_slider_11)  # -> out, a; inputs x: list, y: list, z: list, e: list, u: list
# ---------- python_3: Python ----------
_start = 0
_end = 0

x.append(130.0)
y.append(640.0)
z.append(525.0)
e.append(520.0)


gcode = []


gcode.append("; Body")
gcode.append("G1 Z30" + " F" + str(speed))


for i in xrange(len(u)):
    _end += u[i]


    se = "; layer " + str(i) + ": " + str(_start) + "-" + str(_end)
    gcode.append(se)
    extrude = 0
    
    for j in xrange(_start, _end):
        extrude += float(e[j])
        z_tmp = float(z[_end]) + 30
        text = "G1 X" + str(x[j]) + " Y" + str(y[j]) + " Z" + str(z[j]) + " E" + str(extrude)
        gcode.append(text)

    gcode.append("G1 Z " + str(z_tmp))
    gcode.append("G92 E0")
    _start = _end

    
a = gcode
# ---------- end python_3 ----------
panel_26 = Panel(item_8)
item_9 = ListItem(List=multiplication_14, Index="-1", Wrap=True)
panel_27 = Panel(multiplication_14)

# ---- group: Yoshida
panel_28 = Panel("""G90
M82
M106 S0
M104 S100 T0
M109 S100 T0""")

# ----
python_4 = PythonScript(x=flatten_18, y=flatten_16, z=flatten_17, e=multiplication_14, u=lng_4, speed=number_slider_12)  # -> out, a; inputs x: list, y: list, z: list, e: list, u: list; same code as python_3
panel_29 = Panel(item_9)

# ---- group: Yoshida
panel_30 = Panel("""G90
M82
M106 S0
M104 S100 T0
M109 S100 T0""")

# ----
panel_31 = Panel(python_3.a)
panel_32 = Panel(python_4.a)
txt = Text(python.a)
txt_2 = Text(python_3.a)
list = ValueList({"txt": 1, "gcode": 2}, selected="gcode")
txt_3 = Text(python_2.a)
txt_4 = Text(python_4.a)
list_2 = ValueList({"txt": 1, "gcode": 2}, selected="gcode")

# ---- group: file_name
panel_33 = Panel("181112")

# ----
button = Button()

# ---- group: file_name
panel_34 = Panel("181112")

# ----
panel_35 = Panel(button)
button_2 = Button()
export_gcode_component = GH_CPython(
    PATH="C:\Users\yoshioca\Desktop\",
    File_Name=panel_33,
    File_Type=list,
    layer_height=number_slider_2,
    layer_count=multiplication_11,
    extrude_amp=number_slider_13,
    HEADER=panel_28,
    SKIRT=txt,
    MSG=txt_2,
    TF=button)  # -> a, debug; inputs PATH: list, File_Name: list, File_Type: list, layer_height: list, layer_count: list, extrude_amp: list, HEADER: list, SKIRT: list, MSG: list, TF: list
# ---------- export_gcode_component: Python ----------
from datetime import datetime

def TYPE(num):
    if num == 1:
        type = ".txt"
    elif num == 2:
        type = ".gcode"
    return type


debug = []
comment = []

path_set = str(PATH)
file_name = str(File_Name)
file_type = TYPE(File_Type)
 


# HEADER gode
for i in xrange(len(HEADER)):
    debug.append(HEADER[i])
    debug.append("\n")

debug.append("\n")



# Skirt gode
for i in xrange(len(SKIRT)):
    debug.append(SKIRT[i])
    debug.append("\n")

debug.append("\n")


# Body gcode
for i in xrange(len(MSG)):
    debug.append(MSG[i])
    if i < len(MSG)-1:
        debug.append("\n")


path_out = path_set + "\\" + file_name + file_type

a = path_out

len = len(debug)

# for i in xrange(len):
#     print(debug[i])





if TF:
    now = "; Export Time - " + str(datetime.now().strftime("%Y/%m/%d %H:%M:%S"))
    comment.append(now)
    comment.append("\n")

    height = "; Layer Height(mm) - " + str(layer_height)
    comment.append(height)
    comment.append("\n")

    count = "; Layer Count - " + str(layer_count)
    comment.append(count)
    comment.append("\n")


    amp = "; Extrude Amp - " + str(extrude_amp)
    comment.append(amp)
    comment.append("\n")
    comment.append("\n")

    f = open(path_out, "w")
    f.writelines(comment)
    f.writelines(debug)
    f.close
# ---------- end export_gcode_component ----------
panel_36 = Panel(button_2)
export_gcode_component_2 = GH_CPython(
    PATH="C:\Users\yoshioca\Desktop\",
    File_Name=panel_34,
    File_Type=list_2,
    layer_height=number_slider_7,
    layer_count=multiplication_12,
    extrude_amp=number_slider_14,
    HEADER=panel_30,
    SKIRT=txt_3,
    MSG=txt_4,
    TF=button_2)  # -> a, debug; inputs PATH: list, File_Name: list, File_Type: list, layer_height: list, layer_count: list, extrude_amp: list, HEADER: list, SKIRT: list, MSG: list, TF: list; same code as export_gcode_component
panel_37 = Panel(export_gcode_component.a)
panel_38 = Panel(export_gcode_component.debug)
panel_39 = Panel(export_gcode_component_2.a)
panel_40 = Panel(export_gcode_component_2.debug)
