# Grasshopper definition Write-gcode-ver4.ghx (Grasshopper 0.9.76)
# plug-ins: Python Interpreter, GH_CPython

# ---- group: size
panel = Panel("200")

# ---- group: Grid
number_slider = Slider(20, range=0..100)

# ---- group: layer_height
number_slider_2 = Slider(1.5, range=0.1..30)

# ---- group: Margin
number_slider_3 = Slider(20, range=1..200)

# ----
rectangle = Rectangle(Plane=PlaneXY(0, 0, 0), XSize="0 to 800", YSize="0 to 800", Radius=0)  # -> Rectangle, Length
crv = Curve(rectangle.Rectangle)

# ---- group: layer_count
number_slider_4 = Slider(15, range=1..350)

# ----
number_slider_5 = Slider(150, range=0..1000)
multiplication = Multiplication(A=number_slider_4, B=number_slider_2)
multiplication_2 = Multiplication(A=multiplication, B="2")

# ---- group: Printing Height
panel_2 = Panel(multiplication_2)

# ----
division = Division(A=panel, B=number_slider)
addition = Addition(A=panel, B=number_slider_3)
pt = ConstructPoint(XCoordinate=number_slider_5, YCoordinate=number_slider_5, ZCoordinate=0)
neg = Negative(Value=number_slider_3)
addition_2 = Addition(A=addition, B=number_slider_3)
neg_2 = Negative(Value=addition_2)
Y = UnitY(Factor=neg)
X = UnitX(Factor=number_slider)
Y_2 = UnitY(Factor=addition)
Y_3 = UnitY(Factor=neg_2)
preview = CustomPreview(Geometry=crv, Shader=ColourSwatch(SwatchColor=RGB(255, 255, 255)))
crv_2 = Curve(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)
move = Move(Geometry=pt, Motion=Y)  # -> Geometry, Transform
move_2 = Move(Geometry=pt, Motion=Y_2)  # -> Geometry, Transform
move_3 = Move(Geometry=move_2.Geometry, Motion=X)  # -> Geometry, Transform
move_4 = Move(Geometry=move_3.Geometry, Motion=Y_3)  # -> Geometry, Transform
move_5 = Move(Geometry=move_4.Geometry, Motion=X)  # -> Geometry, Transform
integer_division = IntegerDivision(A=division, B="2")
flatten = FlattenTree(Tree=crv_2, Path="{0}")
multiplication_3 = Multiplication(A=number_slider, B="2")
merge = Merge(Data1=move.Geometry, Data2=move_2.Geometry, Data3=move_3.Geometry, Data4=move_4.Geometry, Data5=move_5.Geometry)
disc = Discontinuity(Curve=flatten, Level=1)  # -> Points, Parameters
series = Series(Start=0, Step=multiplication_3, Count=integer_division)
pline = PolyLine(Vertices=merge, Closed=False)
X_2 = UnitX(Factor=series)
panel_3 = Panel(disc.Points)
shift = ShiftList(List=disc.Points, Shift="1", Wrap=True)
pdecon = Deconstruct(Point=disc.Points)  # -> XComponent, YComponent, ZComponent
move_6 = Move(Geometry=pline, Motion=X_2)  # -> Geometry, Transform
dist = Distance(PointA=disc.Points, PointB=shift)
vec2pt = Vector2Pt(PointA=move.Geometry, PointB=move_2.Geometry, Unitize=False)  # -> Vector, Length
num = Number(pdecon.YComponent)
num_2 = Number(pdecon.ZComponent)
num_3 = Number(pdecon.XComponent)
join = JoinCurves(Curves=move_6.Geometry, Preserve=False)
rev = ReverseList(List=dist)
lng = ListLength(List=num_3)  # -> flatten(Length)
flatten_2 = FlattenTree(Tree=num, Path="{0}")
flatten_3 = FlattenTree(Tree=num_2, Path="{0}")
flatten_4 = FlattenTree(Tree=num_3, Path="{0}")
end = EndPoints(Curve=join)  # -> Start, End
move_7 = Move(Geometry=end.End, Motion=vec2pt.Vector)  # -> Geometry, Transform

# ---- group: Speed
number_slider_6 = Slider(4500, range=2000..5000)

# ----
split = SplitList(List=rev, Index="1")  # -> ListA, ListB
ln = Line(StartPoint=end.End, EndPoint=move_7.Geometry)
merge_2 = Merge(Data1=join, Data2=ln)
rev_2 = ReverseList(List=split.ListB)
join_2 = JoinCurves(Curves=merge_2, Preserve=False)
ins = InsertItems(List=rev_2, Item="0", Indices="0", Wrap=True)
crv_3 = Curve(join_2)
flatten_5 = FlattenTree(Tree=ins, Path="{0}")  # -> simplify(Tree)
panel_4 = Panel(join_2)

# ---- group: amp
number_slider_7 = Slider(8, range=1..10)

# ----
panel_5 = Panel(lng)
bbox = BoundingBox(Content=crv_3, Plane=PlaneXY(0, 0, 0))  # -> Box, Box_2
viewer = ParamViewer(flatten_5)
multiplication_4 = Multiplication(A=flatten_5, B=number_slider_7)
area = Area(Geometry=bbox.Box_2)  # -> Area, Centroid
pdecon_2 = Deconstruct(Point=area.Centroid)  # -> XComponent, YComponent, ZComponent
python = PythonScript(x=flatten_4, y=flatten_2, z=flatten_3, e=multiplication_4, u=lng, speed=number_slider_6)  # -> out, a; inputs x: list, y: list, z: list, e: list, u: list
# ---------- python: Python ----------
_start = 0
_end = 0

gcode = []


gcode.append("; Skirt")
gcode.append("G1 Z30" + " F" + str(speed))


for i in xrange(len(u)):
    _end += u[i]
    extrude = 0
   

    se = "; layer " + str(i)# + ", " + str(_start) + "-" + str(_end)
    gcode.append(se)
    
    for j in xrange(_start, _end):
        extrude += float(e[j])
        z_tmp = float(z[0]) + 30
        text = "G1 X" + str(x[j]) + " Y" + str(y[j]) + " Z" + str(z[j]) + " E" + str(extrude)
        gcode.append(text)

    gcode.append("G1 Z " + str(z_tmp))
    gcode.append("G92 E0")
    #print(_start, _end)
    _start = _end + 1

    
a = gcode
# ---------- end python ----------
pt_2 = ConstructPoint(XCoordinate=pdecon_2.XComponent, YCoordinate=pdecon_2.YComponent, ZCoordinate=0)
rotate = Rotate(Geometry=crv_3, Angle="0.5 * pi", Plane=pt_2)  # -> Geometry, Transform
merge_3 = Merge(Data1=crv_2, Data2=crv_3, Data3=rotate.Geometry)  # -> flatten(Result)
crv_4 = Curve(merge_3)
crv_5 = Curve(rotate.Geometry)
disc_2 = Discontinuity(Curve=crv_3, Level=1)  # -> Points, Parameters
viewer_2 = ParamViewer(disc_2.Points)
multiplication_5 = Multiplication(A=number_slider_2, B="2")
series_2 = Series(Start=number_slider_2, Step=multiplication_5, Count=number_slider_4)
series_3 = Series(Start=multiplication_5, Step=multiplication_5, Count=number_slider_4)
Z = UnitZ(Factor=series_2)
Z_2 = UnitZ(Factor=series_3)
move_8 = Move(Geometry=crv_3, Motion=Z)  # -> Geometry, Transform
move_9 = Move(Geometry=crv_5, Motion=Z_2)  # -> Geometry, Transform
graft = GraftTree(Tree=move_8.Geometry, IncludeEmptyLists=True, IncludeNullItems=True)
graft_2 = GraftTree(Tree=move_9.Geometry, IncludeEmptyLists=True, IncludeNullItems=True)
simplify = SimplifyTree(Tree=graft, Front=False)
simplify_2 = SimplifyTree(Tree=graft_2, Front=False)
merge_4 = Merge(Data1=simplify, Data2=simplify_2)
panel_6 = Panel(python.a)
crv_6 = Curve(merge_4)
dispatch = Dispatch(DispatchPattern=[True, False])  # -> ListA, ListB
flatten_6 = FlattenTree(Tree=crv_6, Path="{0}")
crv_7 = Curve(flatten_6)
disc_3 = Discontinuity(Curve=crv_7, Level=1)  # -> Points, Parameters
panel_7 = Panel(disc_3.Points)
flip = FlipMatrix(Data=disc_3.Points)
shift_2 = ShiftList(List=disc_3.Points, Shift="1", Wrap=True)
pdecon_3 = Deconstruct(Point=disc_3.Points)  # -> XComponent, YComponent, ZComponent
dist_2 = Distance(PointA=disc_3.Points, PointB=shift_2)
num_4 = Number(pdecon_3.YComponent)
num_5 = Number(pdecon_3.ZComponent)
num_6 = Number(pdecon_3.XComponent)
lng_2 = ListLength(List=num_6)  # -> flatten(Length)
rev_3 = ReverseList(List=dist_2)
flatten_7 = FlattenTree(Tree=num_4, Path="{0}")
flatten_8 = FlattenTree(Tree=num_5, Path="{0}")
flatten_9 = FlattenTree(Tree=num_6, Path="{0}")
split_2 = SplitList(List=rev_3, Index="1")  # -> ListA, ListB
panel_9 = Panel(dist_2)
rev_4 = ReverseList(List=split_2.ListB)
multiplication_6 = Multiplication(A=number_slider_4, B="2")
item = ListItem(List=flatten_8, Index="-1", Wrap=True)
item_2 = ListItem(List=flatten_7, Index="-1", Wrap=True)
item_3 = ListItem(List=flatten_9, Index="-1", Wrap=True)
ins_2 = InsertItems(List=rev_4, Item="0", Indices="0", Wrap=True)
panel_10 = Panel(item_3)
flatten_10 = FlattenTree(Tree=ins_2, Path="{0}")  # -> simplify(Tree)
viewer_3 = ParamViewer(flatten_9)
multiplication_7 = Multiplication(A=flatten_10, B=number_slider_7)
panel_11 = Panel(lng_2)
item_4 = ListItem(List=multiplication_7, Index="-1", Wrap=True)
panel_12 = Panel(multiplication_7)
python_2 = PythonScript(x=flatten_9, y=flatten_7, z=flatten_8, e=multiplication_7, u=lng_2, speed=number_slider_6)  # -> out, a; inputs x: list, y: list, z: list, e: list, u: list
# ---------- python_2: Python ----------
_start = 0
_end = 0

x.append(130.0)
y.append(640.0)
z.append(525.0)
e.append(520.0)


gcode = []


gcode.append("; Body")
gcode.append("G1 Z30" + " F" + str(speed))


for i in xrange(len(u)):
    _end += u[i]


    se = "; layer " + str(i) + ": " + str(_start) + "-" + str(_end)
    gcode.append(se)
    extrude = 0
    
    for j in xrange(_start, _end):
        extrude += float(e[j])
        z_tmp = float(z[_end]) + 30
        text = "G1 X" + str(x[j]) + " Y" + str(y[j]) + " Z" + str(z[j]) + " E" + str(extrude)
        gcode.append(text)

    gcode.append("G1 Z " + str(z_tmp))
    gcode.append("G92 E0")
    _start = _end

    
a = gcode
# ---------- end python_2 ----------
panel_13 = Panel(item_4)

# ---- group: Yoshida
panel_14 = Panel("""G90
M82
M106 S0
M104 S100 T0
M109 S100 T0""")

# ----
panel_15 = Panel(python_2.a)
txt = Text(python.a)
txt_2 = Text(python_2.a)
list = ValueList({"txt": 1, "gcode": 2}, selected="gcode")

# ---- group: file_name
panel_16 = Panel("181112")

# ----
button = Button()
panel_17 = Panel(button)
export_gcode_component = GH_CPython(
    PATH="C:\Users\yoshioca\Desktop\",
    File_Name=panel_16,
    File_Type=list,
    layer_height=number_slider_2,
    layer_count=multiplication_6,
    extrude_amp=number_slider_7,
    HEADER=panel_14,
    SKIRT=txt,
    MSG=txt_2,
    TF=button)  # -> a, debug; inputs PATH: list, File_Name: list, File_Type: list, layer_height: list, layer_count: list, extrude_amp: list, HEADER: list, SKIRT: list, MSG: list, TF: list
# ---------- export_gcode_component: Python ----------
from datetime import datetime

def TYPE(num):
    if num == 1:
        type = ".txt"
    elif num == 2:
        type = ".gcode"
    return type


debug = []
comment = []

path_set = str(PATH)
file_name = str(File_Name)
file_type = TYPE(File_Type)
 


# HEADER gode
for i in xrange(len(HEADER)):
    debug.append(HEADER[i])
    debug.append("\n")

debug.append("\n")



# Skirt gode
for i in xrange(len(SKIRT)):
    debug.append(SKIRT[i])
    debug.append("\n")

debug.append("\n")


# Body gcode
for i in xrange(len(MSG)):
    debug.append(MSG[i])
    if i < len(MSG)-1:
        debug.append("\n")


path_out = path_set + "\\" + file_name + file_type

a = path_out

len = len(debug)

# for i in xrange(len):
#     print(debug[i])





if TF:
    now = "; Export Time - " + str(datetime.now().strftime("%Y/%m/%d %H:%M:%S"))
    comment.append(now)
    comment.append("\n")

    height = "; Layer Height(mm) - " + str(layer_height)
    comment.append(height)
    comment.append("\n")

    count = "; Layer Count - " + str(layer_count)
    comment.append(count)
    comment.append("\n")


    amp = "; Extrude Amp - " + str(extrude_amp)
    comment.append(amp)
    comment.append("\n")
    comment.append("\n")

    f = open(path_out, "w")
    f.writelines(comment)
    f.writelines(debug)
    f.close
# ---------- end export_gcode_component ----------
panel_18 = Panel(export_gcode_component.a)
panel_19 = Panel(export_gcode_component.debug)
