# Grasshopper definition grid-ver1.ghx (Grasshopper 0.9.76)

# ---- group: step
number_slider = Slider(20, range=0..100)

# ---- group: length
number_slider_2 = Slider(600, range=0..1000)

# ----
integer_division = IntegerDivision(A=number_slider_2, B=number_slider)
subtraction = Subtraction(A=number_slider_2, B=Slider(50, range=0..100))
rectangle = Rectangle(Plane=PlaneXY(0, 0, 0), XSize="0 to 800", YSize="0 to 800", Radius=0)  # -> Rectangle, Length
pt = ConstructPoint(XCoordinate=0, YCoordinate=0, ZCoordinate=0)
series = Series(Start=0, Step=number_slider, Count=integer_division)
preview = CustomPreview(Geometry=rectangle.Rectangle, Shader=ColourSwatch(SwatchColor=RGB(255, 255, 255)))
Y = UnitY(Factor=number_slider)
integer_division_2 = IntegerDivision(A=subtraction, B=number_slider)
X = UnitX(Factor=series)
multiplication = Multiplication(A=number_slider, B="2")
move = Move(Geometry=pt, Motion=X)  # -> Geometry, Transform
integer_division_3 = IntegerDivision(A=integer_division_2, B="2")
rev = ReverseList(List=move.Geometry)
series_2 = Series(Start=0, Step=multiplication, Count=integer_division_3)
move_2 = Move(Geometry=rev, Motion=Y)  # -> Geometry, Transform
merge = Merge(Data1=move.Geometry, Data2=move_2.Geometry)
Y_2 = UnitY(Factor=series_2)
move_3 = Move(Geometry=merge, Motion=graft(Y_2))  # -> Geometry, Transform
flatten = FlattenTree(Tree=move_3.Geometry, Path="{0}")
viewer = ParamViewer(move_3.Geometry)
bbox = BoundingBox(Content=flatten, Plane=PlaneXY(0, 0, 0), UnionBox=True)  # -> Box, Box_2
area = Area(Geometry=bbox.Box)  # -> Area, Centroid
pdecon = Deconstruct(Point=area.Centroid)  # -> XComponent, YComponent, ZComponent
pt_2 = ConstructPoint(XCoordinate=pdecon.XComponent, YCoordinate=pdecon.YComponent, ZCoordinate=0)
vec2pt = Vector2Pt(PointA=pt_2, PointB=move_3.Geometry, Unitize=False)  # -> Vector, Length
dist = Distance(PointA=pt_2, PointB=move_3.Geometry)
viewer_2 = ParamViewer(dist)
panel = Panel(dist)
bnd = Bounds(Numbers=flatten(dist))
dom = ConstructDomain(DomainStart=Slider(58, range=0..100), DomainEnd=Slider(0, range=0..100))
remap = RemapNumbers(Value=dist, Source=bnd, Target=dom)  # -> Mapped, Clipped
amp = Amplitude(Vector=vec2pt.Vector, Amplitude=remap.Mapped)
bnd_2 = Bounds(Numbers=flatten(amp))
move_4 = Move(Geometry=move_3.Geometry, Motion=amp)  # -> Geometry, Transform
panel_2 = Panel(bnd_2)
pline = PolyLine(Vertices=flatten(move_4.Geometry), Closed=False)
rotate = Rotate(Geometry=pline, Angle="0.5*pi", Plane=pt_2)  # -> Geometry, Transform
